# Grasshopper definition pathToGcode.gh (Grasshopper 1.0.7)

path = FilePath("C:\Users\Ana\Documents\CS291-I\UIST Demo\SculptARHololensApp\Assets\StreamingAssets\toolpath.csv")

# ----
# Potterbot Config
extrusion_multiplier = Slider(1.82, range=0..10)
print_speed_mm_s = Slider(40, range=0..200)
layer_height_mm = Slider(5.1, range=0..7)
nozzle_diam_mm = Slider(8, range=0..8)
box = DomainBox(Base=PlaneXY(0, 0, 0), X="415", Y="405", Z="500")

number_slider = Slider(3, range=0..10)
z0 = Slider(0, range=-20..10)
pt = ConstructPoint(XCoordinate=Slider(0, range=-1000..300), YCoordinate=Slider(0, range=-1000..300), ZCoordinate=z0)

python = GhPythonScript(filepath=path, base_layers=number_slider, base_layer_height=layer_height_mm)  # -> out, points, nbPoints, radius, center_point
# ---------- python: Python ----------
"""Provides a scripting component.
    Inputs:
        filepath: the csv file
    Output:
        nbPoints: number of points across radious
        radius: radious lenght in cm
        center_point: coordinates of center point
        points: coordinates of toolpath points"""

__author__ = "Ana"
__version__ = "2023.07.14"

import csv
import rhinoscriptsyntax as rs

def process_csv(filename):
    with open(filename, 'r') as file:
        reader = csv.reader(file)
        
        # Skip the header row
        next(reader)
        
        # read nbPoints and radius
        nbPoints, radius = next(reader)
        nbPoints = int(nbPoints)
        radius = float(radius)

        # skip header lines for cx,cy,cz
        next(reader)
        
        # read cx, cy, cz and create point
        cx, cy, cz = next(reader)
        center_point = rs.CreatePoint(float(cx) * 1000, float(cz) * 1000, float(cy) * 1000)
        
        # skip header line for x,y,z
        next(reader)
        
        # read the rest of the lines, create points and store them in array
        points = []
        for line in reader:
            x, y, z = line
            point = rs.CreatePoint(float(x) * 1000, float(z) * 1000, float(y) * 1000 + (base_layers * base_layer_height))
            points.append(point)
            
    return nbPoints, radius * 10, center_point, points

# usage:
nbPoints, radius, center_point, points = process_csv(filepath)
print(center_point)
# ---------- end python ----------
pt_2 = Point(python.center_point)
pt_3 = Point(python.points)
panel = Panel(python.radius)

base = Base(
    position=pt,
    nblayers=number_slider,
    nbpoints=python.nbPoints,
    layerheight=layer_height_mm,
    thickness=nozzle_diam_mm,
    radius=python.radius)  # -> out, path

merge = Merge(Data1=flatten(base.path), Data2=flatten(python.points))
center_print = CenterPrint(path=merge, domainbox=box)
g_code_generator = GCodeGenerator(path=center_print, layerheight=layer_height_mm, nozzlediameter=nozzle_diam_mm, printspeed=print_speed_mm_s)  # -> gcode, nbtubes, clayheight

# ---- group: Renders Path Preview
pline = PolyLine(Vertices=center_print, Closed=False)

# ---- group: Clay/tube usage
# Number of tubes
# Clay height (mm)
panel_2 = Panel(g_code_generator.nbtubes)
panel_3 = Panel(g_code_generator.clayheight)

# ----
panel_4 = Panel(g_code_generator.gcode)

# ==== cluster Base: The base is circular and its specific shape is defined by its nbPointInLayer.
position = ClusterInput()  # point (x, y, z) to position form center
nblayers = ClusterInput()  # number of layers in form
layerheight = ClusterInput()  # layer height, should be around half the nozzle size
nbpoints = ClusterInput()  # number of points per layer
thickness = ClusterInput()  # layer thickness, should be around the nozzle size used to print
radius = ClusterInput()  # the radius of the base
base = GhPythonScript(position=position, nbLayers=nblayers, nbPoints=nbpoints, layerHeight=layerheight, thickness=thickness, radius=radius)  # -> out, path; inputs position: Point3d, nbLayers: Int32, nbPoints: Int32
# ---------- base: Python ----------
__author__ = "sami_"
__version__ = "2022.08.08"

import rhinoscriptsyntax as rs
import math
import Rhino
from System import *
from Rhino import *
from Rhino.DocObjects import *
from Rhino.Geometry import *
from Rhino.Input import *
from Rhino.Input.Custom import *
from Rhino.Commands import *
from scriptcontext import doc

path = []
curves = []
contour = []
#p0 = rs.CurveStartPoint(curve)
#radius = p0.X
currentHeight = position.Z

#vectors = []
for j in range(0, nbLayers):
    contour = []
    if j != 1:
        for i in range(0, nbPoints):
            angle = 360/nbPoints
            #print(scaleFunction[j])
            #path.append(rs.CreatePoint(position.X+(radius+scaleFunction[j]+radiusFunction[i])*math.cos(i*angle*math.pi/180 + rotateFunction[j]*math.pi/180)+translateFunction[j].X, position.Y+(radius + scaleFunction[j] + +radiusFunction[i])*math.sin(i*angle*math.pi/180+rotateFunction[j]*math.pi/180)+translateFunction[j].Y, position.Z+layerHeight*j)) #*layerHeight/nbPoints
            path.append(rs.CreatePoint(position.X+radius*math.cos(i*angle*math.pi/180), position.Y+radius*math.sin(i*angle*math.pi/180), position.Z+layerHeight*j)) #*layerHeight/nbPoints
            contour.append(rs.CreatePoint(path[len(path) - 1].X-position.X, path[len(path) - 1].Y-position.Y, 0))
            #contour.append(path[len(path) - 1])
            #vectors.append(rs.VectorUnitize(rs.VectorCreate(rs.CreatePoint(0,0,0), rs.CreatePoint(math.cos(i*angle*math.pi/180), math.sin(i*angle*math.pi/180), 0))))
        path.append(path[len(path) - nbPoints] )
        contour.append(rs.CreatePoint(path[len(path) - 1].X-position.X, path[len(path) - 1].Y-position.Y, 0))
        #contour.append(path[len(path) - 1])
    
    if j % 2 == 0:
        a = rs.AddPolyline(contour)
        centroid = rs.CurveAreaCentroid(a)
        centroid = centroid[0]
        #centroid = position
        print(centroid)
        c = rs.CurveClosestPoint(a, centroid)
        point = rs.EvaluateCurve(a, c)
        g = rs.VectorAdd(point, -centroid)
        print(g)
        #center = rs.CreatePoint(centroid.X, centroid.Y, 0)
        d = rs.VectorLength(g)
        div = d / thickness
        srf = rs.AddPlanarSrf([a])
        plane = rs.CurvePlane(a)
        crv= rs.coercecurve(a)
        St = Rhino.Geometry.CurveOffsetCornerStyle.Sharp
        center = rs.AddPoint(position.X,position.Y,0)
        
        for i in range(1,int(div)):
            #series.append(i*thickness)
            #print(i*thickness)
            #print(centroid)
            #print(rs.CurvePoints(a)[0])
            #print(i)
            #curveOff = rs.OffsetCurve(a,center,-0.001, normal=None, style=1)
            scaleRatio = (radius - i*thickness)/radius
            """curve0 = rs.ScaleObject(a, center, (scaleRatio, scaleRatio, 0), True)
            curve = rs.MoveObject(curve0, rs.AddPoint(0,0,currentHeight))"""
            #b = rs.AddCurve(a)
            #curve = rs.coercecurve(b)
            #curve[0].Scale(i*thickness/radius)
            #print()
            curve = crv.Offset(plane, -0.001, 0.01, St)
            
            curve[0].Scale(scaleRatio)
            curve[0].Translate(position.X,position.Y,currentHeight)
            #curve = crv.OffsetOnSurface(rs.coercesurface(srf), i*thickness, 100)
            #print(curve)
            #print(len(curve))
            #ccurve = rs.AddCurve(curve[0])
            curves.append(curve[0])
            #for p in rs.CurvePoints(ccurve):
            if curve != None:
                #for p in rs.CurvePoints(curve):
                for p in range(0, nbPoints):
                    path.append(curve[0].PointAt(p))
            else:
                #print(-i*thickness)
                print()
    else:
        pp1 = rs.CreatePoint(path[0].X - position.X, path[0].Y-position.X, path[0].Z)
        pp2 = rs.CreatePoint(path[0].X-2*radius - position.X, path[0].Y-position.X, path[0].Z)
        srf = rs.AddPlanarSrf([a])
        geo = rs.coercegeometry(srf)
        path2 = []
        contours = Brep.CreateContourCurves(geo, pp1, pp2, thickness)
        switch = True
        for cc in contours:
            start = cc.PointAtNormalizedLength(0)
            end = cc.PointAtNormalizedLength(1)
            if switch:
                path.append(rs.CreatePoint(start.X + position.X, start.Y + position.Y, start.Z + currentHeight))
                path.append(rs.CreatePoint(end.X + position.X, end.Y + position.Y, end.Z + currentHeight))
                switch = False
            else:
                path.append(rs.CreatePoint(end.X+ position.X, end.Y+ position.Y, end.Z + currentHeight))
                path.append(rs.CreatePoint(start.X+ position.X, start.Y+ position.Y, start.Z + currentHeight))
                switch = True
    currentHeight += layerHeight


"""path1 = []
a = rs.AddPolyline(path)
centroid = rs.CurveAreaCentroid(a)
centroid = centroid[0]
print(centroid)
c = rs.CurveClosestPoint(a, centroid)
point = rs.EvaluateCurve(a, c)
g = rs.VectorAdd(point, -centroid)
d = rs.VectorLength(g)
div = d / thickness
srf = rs.AddPlanarSrf([a])

for i in range(1,int(div)):
    #series.append(i*thickness)
    #print(i*thickness)
    #print(centroid)
    #print(rs.CurvePoints(a)[0])
    #print(i)
    curve = rs.OffsetCurve(a,centroid,i*thickness)
    curves.append(rs.coercecurve(curve))
    for p in rs.CurvePoints(curve):
        path1.append(p)
    #curves.append(curve)
    #curve = rs.OffsetCurve(a, 
#curves = rs.OffsetCurve(a,centroid,thickness)
"""

"""pp1 = path[0]
pp2 = rs.CreatePoint(path[0].X-2*radius, path[0].Y, path[0].Z)
srf = rs.AddPlanarSrf([a])
geo = rs.coercegeometry(srf)
path2 = []
contours = Brep.CreateContourCurves(geo, pp1, pp2, thickness)
switch = True
for cc in contours:
    start = cc.PointAtNormalizedLength(0)
    end = cc.PointAtNormalizedLength(1)
    if switch:
        path2.append(rs.CreatePoint(start.X, start.Y, start.Z + layerHeight))
        path2.append(rs.CreatePoint(end.X, end.Y, end.Z + layerHeight))
        switch = False
    else:
        path2.append(rs.CreatePoint(end.X, end.Y, end.Z + layerHeight))
        path2.append(rs.CreatePoint(start.X, start.Y, start.Z + layerHeight))
        switch = True"""
# ---------- end base ----------
path = ClusterOutput(base.path)  # ordered array of points (point3d)
out = ClusterOutput(base.out)  # console output

# ==== cluster CenterPrint: Move print to center of input box.
path = ClusterInput()
domainbox = ClusterInput()

# ----
# Center print on the bed
pline = PolyLine(Vertices=path, Closed=False)
box = EvaluateBox(Box=pline, UParameter="0.5", VParameter="0.5", WParameter="0")  # -> Plane, Point, Include
box_2 = EvaluateBox(Box=domainbox, UParameter="0.5", VParameter="0.5", WParameter="0")  # -> Plane, Point, Include
vec2pt = Vector2Pt(PointA=box.Point, PointB=box_2.Point, Unitize=False)  # -> Vector, Length
move = Move(Geometry=path, Motion=vec2pt.Vector)  # -> Geometry, Transform

path_2 = ClusterOutput(move.Geometry)

# ==== cluster GCodeGenerator
nozzlediameter = ClusterInput()
printspeed = ClusterInput()
path = ClusterInput()
layerheight = ClusterInput()

# ---- group: Extrusion
pline = PolyLine(Vertices=path, Closed=False)
explode = Explode(Curve=pline, Recursive=True)  # -> Segments, Vertices
len = Length(Curve=explode.Segments)
py_extrusion = GhPythonScript(LayerHeight=layerheight, NozzleWidth=nozzlediameter, SegmentLen=len)  # -> E
# ---------- py_extrusion: Python ----------
__author__ = "mert_toka"
__version__ = "2022.04.29"

import rhinoscriptsyntax as rs
import math

# input
NozzleWidth
LayerHeight
SegmentLen

# output
E = 0

E = SegmentLen*LayerHeight/NozzleWidth * (4/math.pi + LayerHeight/NozzleWidth)
#E = (4*LayerHeight*SegmentLen*ExtrusionMultiplier) / (math.pi*NozzleWidth)
# ---------- end py_extrusion ----------
ins = InsertItems(List=py_extrusion, Item="0", Indices="0", Wrap=True)
ma = MassAddition(Input=ins)  # -> Result, PartialResults

# ---- group: XYZ
pdecon = Deconstruct(Point=path)  # -> XComponent, YComponent, ZComponent

# ---- group: Feedrate
multiplication = Multiplication(A=printspeed, B="60")
merge = Merge(Data1="10000", Data2=multiplication)  # -> flatten(Result)

# ----
lastdex = LastIndex(List=ma.PartialResults)
py_adjustext = GhPythonScript(extrusions=py_extrusion)  # -> modE; inputs extrusions: list
# ---------- py_adjustext: Python ----------
__author__ = "mert_"
__version__ = "2022.10.18"

import rhinoscriptsyntax as rs

# Input
extrusions

min = 0.8
max = 1.5

# Output
modE = []

def map(value, istart, istop, ostart, ostop):
    return ostart + (ostop - ostart) * ((value - istart) / (istop - istart))

maxIdx = len(extrusions)
midIdx = maxIdx*0.5
for i, e in enumerate(extrusions):
    modE.append(e*map(i, 0, maxIdx-1, max, min))
    
#    if i < midIdx:
#        modE.append(e*map(i, 0, midIdx, max, min))
#    else:
#        modE.append(e*map(i, midIdx, maxIdx, min, max))
# ---------- end py_adjustext ----------
item = ListItem(List=ma.PartialResults, Index=lastdex, Wrap=True)
expression = Expression(x=nozzlediameter, y=item, Expression="((x/2)^2*y)/((95.5/2)^2)/430")

# ---- group: Extrusion Multiplier for correct filament thickness
expression_2 = Expression(x=nozzlediameter, Expression="(x/1.91)^2")
multiplication_2 = Multiplication(A=ma.PartialResults, B=expression_2)

# ----
multiplication_3 = Multiplication(A=expression, B=430)
p_roundgcode = GhPythonScript(f=merge, x=pdecon.XComponent, y=pdecon.YComponent, z=pdecon.ZComponent, e=multiplication_2)  # -> f, x, y, z, e
# ---------- p_roundgcode: Python ----------
__author__ = "mert_toka"
__version__ = "2022.02.02"

import rhinoscriptsyntax as rs

_x = int(x*100)/100.0
_y = int(y*100)/100.0
_z = int(z*100)/100.0
_e = int(e*10000)/10000.0
_f = int(f*100)/100.0
# ---------- end p_roundgcode ----------
nbtubes = ClusterOutput(expression)
clayheight = ClusterOutput(multiplication_3)
concat = Concatenate(
    FragmentI="G1",
    FragmentH=" F",
    FragmentJ=p_roundgcode.f,
    FragmentA=" X",
    FragmentB=p_roundgcode.x,
    FragmentC=" Y",
    FragmentD=p_roundgcode.y,
    FragmentE=" Z",
    FragmentF=p_roundgcode.z,
    FragmentG=" E",
    FragmentK=p_roundgcode.e)  # -> flatten(Result)
panel = Panel(concat)
panel_2 = Panel(""";;; === END GCODE ===
M83 ;Set to Relative Extrusion Mode
G28 Z ;Home Z
; === DEPRESSURIZE ===
G91
G91
G1 E-1300 F4000
G90
G90""")
panel_3 = Panel(""";;; START GCODE ;;;
M82 ;absolute extrusion mode
G28 ;Home
G1 X207.5 Y202.5 Z20 F10000 ;Move X and Y to center, Z to 20mm high
G1 E4000 F40000 ; !!Prime Extruder
G92 E0
G1 F30000 E-150
;;; ======""")
merge_2 = Merge(Data1=panel_3, Data2=panel, Data3=panel_2)  # -> flatten(Result)
gcode = ClusterOutput(merge_2)
